# Grasshopper definition light-painting.ghx (Grasshopper 1.0.7)
# plug-ins: KUKA|prc - parametric robot control

# ---- group: Flange
# Tools
panel = Panel("3")
# SETUP
panel_2 = Panel("0")
frame = FrameKUKAPrc(FrameNumber=0, XValue="0", YValue="0", ZValue="0", AValue="0", BValue="0", CValue=panel_2, toolaxis="X")  # -> KUKAPrcFrame, XYZABCAsPlane
custom_tool_pln = CustomToolPlaneKUKAPrc(ToolNumber=panel, ToolPlane=frame.XYZABCAsPlane, frameinput=False)

# ----
# Raccoon KUKA Robot Cell Template
# v0.3.6
# 1. SETUP
# Robot
cluster = Cluster()  # -> robot, robot_2

# ----
# Environment
world_collision = Mesh(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)
world_visual = Mesh([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])

crv = Curve(<curve referenced from the Rhino model>)
crv_2 = Curve(<curve referenced from the Rhino model>)
# 2. OPERATIONS
boundary = Data([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])

# ----
# East Robot
save_krl_file = Button()
project_name_abbreviation_max_3_chr = Panel("ABR")
# 3. Simulation, Analysis, Post-Processing
number_slider = Slider(0.2515, range=0..1)
robot_prefix = Panel("E")
operation_name_max_8_chr = Panel("OPRTN")
python = GhPythonScript(
    robot_prefix=robot_prefix,
    project_abbr=project_name_abbreviation_max_3_chr,
    operation_name=operation_name_max_8_chr,
    SAVE=save_krl_file)  # -> SAVE, NAME; inputs SAVE: Boolean
# ---------- python: Python ----------
from datetime import datetime
import string

robot_prefix = "R" if robot_prefix is None else robot_prefix
project_abbr = "prj" if project_abbr is None else project_abbr
operation_name= "operation" if operation_name is None else operation_name

def remove_invalid_char(a_str):
    valid_chars = "-_%s%s" % (string.ascii_letters, string.digits)
    return ''.join(
        filter(lambda x: x in valid_chars, a_str)
    )


comps=[robot_prefix, project_abbr, operation_name]

for i, comp in enumerate(comps):
    comps[i] = remove_invalid_char(comp)

    
# Prefix=1, project_abbr=3, operation_name=8, timestamp=9
comps[0] = comps[0][:1] if len(comps[0]) > 1 else comps[0]
comps[1] = comps[1][:3] if len(comps[1]) > 3 else comps[1]
comps[2] = comps[2][:8] if len(comps[2]) > 8 else comps[2]
comps.append(datetime.now().strftime("%m%dT%H%M"))

NAME = '_'.join(comps)
# ---------- end python ----------
file_name = Panel(python.NAME)
kuka_prc = KUKAPrcCORE(
    SimulationSlider=number_slider,
    Robot=cluster.robot,
    CollisionGeometry=world_collision,
    SaveToggle=python.SAVE,
    Filename=python.NAME,
    PRC_BaseExpose=False,
    PRC_SaveNameExpose=True,
    PRCsettings="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")  # -> RobotGeometry, AnalysisOutput

divide = DivideCurve(Curve=crv_2, Count=10, Kinks=False)  # -> Points, Tangents, Parameters
Y = UnitY(Factor=-1)
Z = UnitZ(Factor=1)
divide_2 = DivideCurve(Curve=crv, Count=10, Kinks=False)  # -> Points, Tangents, Parameters
Y_2 = UnitY(Factor=-1)
Z_2 = UnitZ(Factor=1)
pl = ConstructPlane(Origin=divide_2.Points, XAxis=Y_2, YAxis=Z_2)
pl_2 = ConstructPlane(Origin=divide.Points, XAxis=Y, YAxis=Z)

# ---- group: Light On
digital_out = DigitalOutputKUKAPrc(DigitalOutputNumber="5", OutputState=Toggle(True), ContinuousMovement=False, ToolState=-1)

# ----
item = ListItem(List=pl, Index=0, Wrap=True)
item_2 = ListItem(List=pl_2, Index=0, Wrap=True)

# ---- group: Light Off
digital_out_2 = DigitalOutputKUKAPrc(DigitalOutputNumber="5", OutputState=Toggle(False), ContinuousMovement=False, ToolState=-1)

# ----
ptp_move = PTPMovementKUKAPrc(TargetAsPlane=item_2, extaxenabled=False, interpolation="C_PTP")
ptp_move_2 = PTPMovementKUKAPrc(TargetAsPlane=item, extaxenabled=False, interpolation="C_PTP")
lin_move = LINearMovementKUKAPrc(TargetAsPlane=pl_2, extaxenabled=False, interpolation="C_DIS")
# OPERATIONS
lin_move_2 = LINearMovementKUKAPrc(TargetAsPlane=pl, extaxenabled=False, interpolation="C_DIS")
entwine = Entwine(
    Branch00=ptp_move,
    Branch01=digital_out,
    Branch02=lin_move,
    Branch03=digital_out_2,
    Branch04=ptp_move_2,
    Branch05=digital_out,
    Branch06=lin_move_2,
    FlattenInputs=True)  # -> flatten(Result)

# ----
# Analysis
analysis_kuka_prc = AnalysisKUKAPrc(KUKAPrcAnalysisData=kuka_prc.AnalysisOutput)  # -> RobotAxisValues, RobotCollisionCheck, RobotReachabilityCheck, CommandID, TimeValue, Planes, CommandTags, IOState, Index, KRL

kuka_command = KUKAPrcCommand(entwine)

# ----
# West Robot
save_krl_file_2 = Button()
robot_prefix_2 = Panel("W")
project_name_abbreviation_max_3_chr_2 = Panel("ABR")
operation_name_max_8_chr_2 = Panel("OPRTN")
python_2 = GhPythonScript(
    robot_prefix=robot_prefix_2,
    project_abbr=project_name_abbreviation_max_3_chr_2,
    operation_name=operation_name_max_8_chr_2,
    SAVE=save_krl_file_2)  # -> SAVE, NAME; inputs SAVE: Boolean; same code as python
file_name_2 = Panel(python_2.NAME)
# 3. Simulation, Analysis, Post-Processing
kuka_prc_2 = KUKAPrcCORE(
    SimulationSlider=Slider(0.2278, range=0..1),
    KUKAPrcCommands=kuka_command,
    Tool=custom_tool_pln,
    Robot=cluster.robot_2,
    CollisionGeometry=world_collision,
    SaveToggle=python_2.SAVE,
    Filename=python_2.NAME,
    PRC_BaseExpose=False,
    PRC_SaveNameExpose=True,
    PRCsettings="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")  # -> RobotGeometry, AnalysisOutput

analysis_kuka_prc_2 = AnalysisKUKAPrc(KUKAPrcAnalysisData=kuka_prc_2.AnalysisOutput)  # -> RobotAxisValues, RobotCollisionCheck, RobotReachabilityCheck, CommandID, TimeValue, Planes, CommandTags, IOState, Index, KRL

# ==== cluster Cluster
kr90_kr270_r2500 = QuantecKR90KR270R2500Robot(infiniterot=False)
panel = Panel("""37.5
2403.3
-2.0
0.0
90.0
-0.1812""")
panel_2 = Panel("""37.0714
2402.8586
-2.0
0.2993
0.0052
0.0001""")
panel_3 = Panel("""0.0
-2400.0
0.0
0.0
90.0
0.0""")
panel_4 = Panel("""-2.06
-2400.320
0
0.01421
-0.0074
0.00""")
west_platform = Mesh(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)
panel_5 = Panel("""675.0
350.0
1150.0
1000.0
-41.0
240.0""")
east_platform = Mesh(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)
rail = Mesh(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)
e1_min = Panel("0")
e1_max = Panel("4270")
item = ListItem(List=panel_3, Index=0, Wrap=True)  # -> Item, Item1, Item2, Item3, Item4, Item5
item_2 = ListItem(List=panel_4, Index=0, Wrap=True)  # -> Item, Item1, Item2, Item3, Item4, Item5
item_3 = ListItem(List=panel, Index=0, Wrap=True)  # -> Item, Item1, Item2, Item3, Item4, Item5
item_4 = ListItem(List=panel_2, Index=0, Wrap=True)  # -> Item, Item1, Item2, Item3, Item4, Item5
custom_robot = CustomRobot(ReferenceRobot=kr90_kr270_r2500, RobotName="KR300-R2500", Layout=panel_5)
frame = FrameKUKAPrc(
    FrameNumber=0,
    XValue=item.Item,
    YValue=item.Item1,
    ZValue=item.Item2,
    AValue=item.Item3,
    BValue=item.Item4,
    CValue=item.Item5,
    toolaxis="X")  # -> KUKAPrcFrame, XYZABCAsPlane
frame_2 = FrameKUKAPrc(
    FrameNumber=0,
    XValue=item_2.Item,
    YValue=item_2.Item1,
    ZValue=item_2.Item2,
    AValue=item_2.Item3,
    BValue=item_2.Item4,
    CValue=item_2.Item5,
    toolaxis="Z")  # -> KUKAPrcFrame, XYZABCAsPlane
frame_3 = FrameKUKAPrc(
    FrameNumber=0,
    XValue=item_3.Item,
    YValue=item_3.Item1,
    ZValue=item_3.Item2,
    AValue=item_3.Item3,
    BValue=item_3.Item4,
    CValue=item_3.Item5,
    toolaxis="X")  # -> KUKAPrcFrame, XYZABCAsPlane
frame_4 = FrameKUKAPrc(
    FrameNumber=0,
    XValue=item_4.Item,
    YValue=item_4.Item1,
    ZValue=item_4.Item2,
    AValue=item_4.Item3,
    BValue=item_4.Item4,
    CValue=item_4.Item5,
    toolaxis="Z")  # -> KUKAPrcFrame, XYZABCAsPlane
deplane = DeconstructPlane(Plane=frame.XYZABCAsPlane)  # -> Origin, XAxis, YAxis, ZAxis
deplane_2 = DeconstructPlane(Plane=frame_3.XYZABCAsPlane)  # -> Origin, XAxis, YAxis, ZAxis
orient = Orient(Geometry=rail, Source=PlaneXY(0, 0, 0), Target=frame_2.XYZABCAsPlane)  # -> Geometry, Transform
orient_2 = Orient(Geometry=west_platform, Source=PlaneXY(0, 0, 0), Target=frame_2.XYZABCAsPlane)  # -> Geometry, Transform
orient_3 = Orient(Geometry=rail, Source=PlaneXY(0, 0, 0), Target=frame_4.XYZABCAsPlane)  # -> Geometry, Transform
orient_4 = Orient(Geometry=east_platform, Source=PlaneXY(0, 0, 0), Target=frame_4.XYZABCAsPlane)  # -> Geometry, Transform
custom_rail = CustomLinearAxisKUKAPrc(
    KUKAPrcRobotInput=custom_robot,
    RobotRail=orient.Geometry,
    RobotPlatform=orient_2.Geometry,
    PositiveLength=e1_max,
    NegativeLength=e1_min,
    PositiveDirection=deplane.XAxis,
    RobotBase=frame_2.XYZABCAsPlane)
custom_rail_2 = CustomLinearAxisKUKAPrc(
    KUKAPrcRobotInput=custom_robot,
    RobotRail=orient_3.Geometry,
    RobotPlatform=orient_4.Geometry,
    PositiveLength=e1_max,
    NegativeLength=e1_min,
    PositiveDirection=deplane_2.XAxis,
    RobotBase=frame_4.XYZABCAsPlane)
robot = ClusterOutput(custom_rail)
robot_2 = ClusterOutput(custom_rail_2)
